# Grasshopper definition branching.ghx (Grasshopper 1.0.8)
# plug-ins: Anemone

base_point = Point(Point(0, 0, 0))
base_point_tip = Point(Point(0, 0, 8))
_0 = Slider(0, range=0..100)
_0_2 = Slider(0, range=0..100)
_60 = Slider(60, range=0..1000)
_360 = Slider(360, range=0..1000)
branches_per_iteration = Slider(1, range=1..5)
trunk_radius = Slider(0.5, range=0.5..5)
length_factor = Slider(0.5, range=0.5..1.5)
radius_factor = Slider(0.5, range=0.5..1.5)
branch_length = Slider(1, range=1..10)
iteration_count = Slider(10, range=0..10)
line = Line(StartPoint=base_point, EndPoint=base_point_tip)
branch_tilt = ConstructDomain(DomainStart=_60, DomainEnd=_0)
rotation_around_trunk = ConstructDomain(DomainStart=_360, DomainEnd=_0_2)
loop_start = LoopStart(Repeat=iteration_count, Trigger=Button(), Data=line)  # -> port, Counter, PreviousLines
end_points = EndPoints(Curve=loop_start.PreviousLines)  # -> Start, End
_1 = Integer(1)
list_item = ListItem(List=end_points.End, Index=_1, Wrap=True)
flatten_tree = FlattenTree(Tree=loop_start.PreviousLines, Path="{0}")
length = Length(Curve=loop_start.PreviousLines)
integer = Integer(1)
list_length = ListLength(List=flatten_tree)
multiplication = Multiplication(A=list_length, B=branches_per_iteration)
branch_tilt_2 = Random(Range=branch_tilt, Number=multiplication, Seed=2)
rotate_around_trunk = Random(Range=rotation_around_trunk, Number=multiplication, Seed=2)
random_tilt_angles = PartitionList(List=branch_tilt_2, Size=branches_per_iteration)
multiplication_2 = Multiplication(A=length, B=length_factor)
trunk_random_angles = PartitionList(List=rotate_around_trunk, Size=branches_per_iteration)
radians = Radians(Degrees=random_tilt_angles)
unit_x = UnitX(Factor=1)
unit_z = UnitZ(Factor=1)
rotate_3d = Rotate3D(Geometry=unit_z, Angle=radians, Center=Point(0, 0, 0), Axis=unit_x)  # -> Geometry, Transform
unit_z_2 = UnitZ(Factor=1)
radians_2 = Radians(Degrees=trunk_random_angles)
rotate_3d_2 = Rotate3D(Geometry=rotate_3d.Geometry, Angle=radians_2, Center=Point(0, 0, 0), Axis=unit_z_2)  # -> Geometry, Transform
graft_tree = GraftTree(Tree=rotate_3d_2.Geometry, IncludeEmptyLists=True, IncludeNullItems=True)
line_sdl = LineSDL(Start=list_item, Direction=graft_tree, Length=multiplication_2)
loop_end = LoopEnd(port=loop_start.port, Exit=False, Data=line_sdl, TimeOutVal=0, pausedState=False, state="Constant & Record")
pipe = Pipe(Curve=loop_end, Radius=1, Caps=0)
