# Grasshopper definition icetent.ghx (Grasshopper 1.0.8)
# plug-ins: Pufferfish, GhPolyhedra, Weaverbird, Kangaroo2 Components

number_slider = Slider(0, range=0..100)
number_slider_2 = Slider(2, range=0..10)
number_slider_3 = Slider(1, range=0..1)
pt = Point(Point(0, 0, 0))
panel = Panel("Elongated Square Cupola")
pt_2 = Point(Point(0, 0, 0))
pt_3 = ConstructPoint(XCoordinate=number_slider, YCoordinate=number_slider, ZCoordinate=number_slider)
pt_4 = ConstructPoint(XCoordinate=number_slider, YCoordinate=number_slider, ZCoordinate=Slider(3, range=0..10))
neg = Negative(Value=Slider(13, range=0..50))
xy = XYPlane(Origin=Point(0, 0, 0))
number_slider_4 = Slider(150, range=0..1000)
pt_5 = ConstructPoint(XCoordinate=number_slider, YCoordinate=number_slider, ZCoordinate=neg)
how_far_out_skirt_is_pinned = Addition(A=number_slider_4, B=Slider(46, range=0..100))
colour = ColourPicker(PickedColour=RGB(142, 153, 173))
ln = Line(StartPoint=pt_2, EndPoint=pt_4)
ln_2 = Line(StartPoint=pt_3, EndPoint=pt_5)
subtraction = Subtraction(A=number_slider_4, B=Slider(12, range=0..40))
non_gyro = Polyhedron(Name=panel, Plane=xy, Scale=subtraction)  # -> Curves, Meshes, Solid
mjoin = MeshJoin(Meshes=non_gyro.Meshes)
non_gyro_2 = Polyhedron(Name=panel, Plane=xy, Scale=number_slider_4)  # -> Curves, Meshes, Solid
number_slider_5 = Slider(0, range=0..100)
pipe = Pipe(Curve=ln, Radius=Slider(4.47, range=0..10), Caps=Slider(1, range=0..1))
non_gyro_3 = Polyhedron(Name="Gyroelongated Square Cupola", Plane=xy, Scale=how_far_out_skirt_is_pinned)  # -> Curves, Meshes, Solid
medges = MeshEdges(Mesh=mjoin)  # -> NakedEdges, InteriorEdges, NonManifoldEdges
pipe_2 = Pipe(Curve=[medges.InteriorEdges, medges.NakedEdges], Radius=Slider(1.65, range=0..10), Caps=Slider(2, range=0..10))
preview = CustomPreview(Geometry=pipe_2, Material=colour)
demesh = DeconstructMesh(Mesh=mjoin)  # -> Vertices, Faces, Colours, Normals
cullpt = CullDuplicates(Points=demesh.Vertices, Tolerance=0.1, CullMode=3)  # -> Points, Indices, Valence
pdecon = Deconstruct(Point=cullpt.Points)  # -> XComponent, YComponent, ZComponent
mjoin_2 = MeshJoin(Meshes=non_gyro_2.Meshes)
number_slider_6 = Slider(0, range=0..100)
demesh_2 = DeconstructMesh(Mesh=mjoin_2)  # -> Vertices, Faces, Colours, Normals
explode = Explode(Curve=non_gyro_3.Curves, Recursive=True)  # -> Segments, flatten(Vertices)
vpipe = PipeVariable(
    Curve=ln_2,
    Parameters=[Slider(0, range=0..100), Slider(1, range=0..1)],
    Radii=[Slider(2.63, range=0..5), Slider(1.43, range=0..5)],
    Caps=Slider(2, range=0..10))
sort = SortList(Keys=pdecon.ZComponent)  # -> Keys, ValuesA
number_slider_7 = Slider(266, range=0..1000)
pt_6 = Point(Point(0, 0, 0))
cullpt_2 = CullDuplicates(Points=demesh_2.Vertices, Tolerance=0.1, CullMode=3)  # -> Points, Indices, Valence
item = ListItem(List=cullpt_2.Points, Index=number_slider_2, Wrap=True)
item_2 = ListItem(List=cullpt_2.Points, Index=number_slider_3, Wrap=True)
item_3 = ListItem(List=cullpt_2.Points, Index=0, Wrap=True)
pl_3pt = Plane3Pt(PointA=item_3, PointB=item_2, PointC=item)
base_plane = Plane(pl_3pt)
movetoplane = MoveToPlane(Geometry=pt, Plane=base_plane, Above=True, Below=True)  # -> Geometry, Transform
cullpt_3 = CullDuplicates(Points=demesh.Vertices, Tolerance=0.1, CullMode=3)  # -> Points, Indices, Valence
medges_2 = MeshEdges(Mesh=mjoin_2)  # -> NakedEdges, InteriorEdges, NonManifoldEdges
pt_7 = Point(Point(0, 0, 0))
pt_8 = ConstructPoint(XCoordinate=number_slider_6, YCoordinate=number_slider_6, ZCoordinate=number_slider_6)
pt_9 = ConstructPoint(XCoordinate=number_slider_6, YCoordinate=number_slider_6, ZCoordinate=Slider(3, range=0..10))
cullpt_4 = CullDuplicates(Points=demesh_2.Vertices, Tolerance=0.1, CullMode=3)  # -> Points, Indices, Valence
movetoplane_2 = MoveToPlane(Geometry=pt_6, Plane=base_plane, Above=True, Below=True)  # -> Geometry, Transform
neg_2 = Negative(Value=Slider(19, range=0..50))
cullpt_5 = CullDuplicates(Points=explode.Vertices, Tolerance=0.1, CullMode=3)  # -> Points, Indices, Valence
base_z = ListItem(List=sort.Keys, Index=0, Wrap=True)
mid_ring_z = ListItem(List=sort.Keys, Index=Slider(9, range=0..10), Wrap=True)
ceiling_z = ListItem(List=sort.Keys, Index=Slider(19, range=0..100), Wrap=True)
pt_10 = ConstructPoint(XCoordinate=number_slider_6, YCoordinate=number_slider_6, ZCoordinate=neg_2)
sunion = SolidUnion(Breps=[pipe, vpipe])
movetoplane_3 = MoveToPlane(Geometry=sunion, Plane=base_plane, Above=True, Below=True)  # -> Geometry, Transform
pdecon_2 = Deconstruct(Point=cullpt_4.Points)  # -> XComponent, YComponent, ZComponent
trim = TrimSolid(Shape=vpipe, Cutters=pipe)
round = Round(Number=ceiling_z)  # -> Nearest, Floor, Ceiling
ln_3 = Line(StartPoint=pt_7, EndPoint=pt_9)
equals = Equality(FirstNumber=base_z, SecondNumber=pdecon.ZComponent)  # -> Equality, Inequality
pdecon_3 = Deconstruct(Point=cullpt_5.Points)  # -> XComponent, YComponent, ZComponent
equals_2 = Equality(FirstNumber=mid_ring_z, SecondNumber=pdecon.ZComponent)  # -> Equality, Inequality
anchor = Anchor(Point=cullpt_3.Points, Strength=Slider(100, range=0..100))
round_2 = Round(Number=pdecon.ZComponent)  # -> Nearest, Floor, Ceiling
equals_3 = Equality(FirstNumber=round.Nearest, SecondNumber=round_2.Nearest)  # -> Equality, Inequality
ln_4 = Line(StartPoint=pt_8, EndPoint=pt_10)
len = Length(Curve=[medges_2.NakedEdges, medges_2.InteriorEdges])
sort_2 = SortList(Keys=pdecon_2.ZComponent)  # -> Keys, ValuesA
smaller = SmallerThan(FirstNumber=pdecon_3.ZComponent, SecondNumber=Slider(0, range=0..100))  # -> SmallerThan, OrEqualTo
base_points = CullPattern(List=cullpt.Points, CullPattern=equals.Equality)
ceiling = CullPattern(List=cullpt.Points, CullPattern=equals_3.Equality)
mid_ring = CullPattern(List=cullpt.Points, CullPattern=equals_2.Equality)
number_slider_8 = Slider(0, range=0..100)
edgelengths = EdgeLengths(Mesh=mjoin, LengthFactor=Slider(1, range=0..1), Strength=Slider(12, range=0..50))
pipe_3 = Pipe(Curve=ln_3, Radius=Slider(5.12, range=0..10), Caps=Slider(1, range=0..1))
show = Show(G=mjoin)
multiplication = Multiplication(A=len, B=Slider(0.75, range=0..1))
base_z_2 = ListItem(List=sort_2.Keys, Index=0, Wrap=True)
mid_ring_z_2 = ListItem(List=sort_2.Keys, Index=Slider(9, range=0..10), Wrap=True)
ceiling_z_2 = ListItem(List=sort_2.Keys, Index=Slider(19, range=0..100), Wrap=True)
cull = CullPattern(List=cullpt_5.Points, CullPattern=smaller.SmallerThan)
xy_2 = XYPlane(Origin=Point(0, 0, 0))
round_3 = Round(Number=ceiling_z_2)  # -> Nearest, Floor, Ceiling
equals_4 = Equality(FirstNumber=base_z_2, SecondNumber=pdecon_2.ZComponent)  # -> Equality, Inequality
vpipe_2 = PipeVariable(
    Curve=ln_4,
    Parameters=[Slider(0, range=0..100), Slider(1, range=0..1)],
    Radii=[Slider(3.13, range=0..5), Slider(2.06, range=0..5)],
    Caps=Slider(2, range=0..10))
stake_points = MoveToPlane(Geometry=cull, Plane=base_plane, Above=True, Below=True)  # -> Geometry, Transform
length_line = LengthLine(Line=[medges_2.NakedEdges, medges_2.InteriorEdges], Length=multiplication, Strength=Slider(6, range=0..10))
number_slider_9 = Slider(266, range=0..1000)
equals_5 = Equality(FirstNumber=mid_ring_z_2, SecondNumber=pdecon_2.ZComponent)  # -> Equality, Inequality
round_4 = Round(Number=pdecon_2.ZComponent)  # -> Nearest, Floor, Ceiling
equals_6 = Equality(FirstNumber=round_3.Nearest, SecondNumber=round_4.Nearest)  # -> Equality, Inequality
pt_11 = Point(Point(0, 0, 0))
base_points_2 = CullPattern(List=cullpt_4.Points, CullPattern=equals_4.Equality)
ceiling_2 = CullPattern(List=cullpt_4.Points, CullPattern=equals_6.Equality)
mid_ring_2 = CullPattern(List=cullpt_4.Points, CullPattern=equals_5.Equality)
item_4 = ListItem(List=mid_ring_2, Index=0, Wrap=True)
movetoplane_4 = MoveToPlane(Geometry=item_4, Plane=xy_2, Above=True, Below=True)  # -> Geometry, Transform
movetoplane_5 = MoveToPlane(Geometry=pt_11, Plane=base_plane, Above=True, Below=True)  # -> Geometry, Transform
entwine = Entwine(Branch00=show, Branch01=anchor, Branch02=edgelengths, Branch03=edgelengths, FlattenInputs=True)
solver = Solver(GoalObjects=entwine, Reset=Button(), Threshold=1e-15, Tolerance=0.01, On=True)  # -> I, V, flatten(O)
sunion_2 = SolidUnion(Breps=[pipe_3, vpipe_2])
movetoplane_6 = MoveToPlane(Geometry=sunion_2, Plane=base_plane, Above=True, Below=True)  # -> Geometry, Transform
movetoplane_7 = MoveToPlane(Geometry=sunion_2, Plane=base_plane, Above=True, Below=True)  # -> Geometry, Transform
cps = ClosestPoints(Point=stake_points.Geometry, Cloud=mid_ring_2, Count=Slider(2, range=0..10))  # -> ClosestPoint, CPIndex, Distance
end = EndPoints()  # -> Start, End
trim_2 = TrimSolid(Shape=vpipe_2, Cutters=pipe_3)
pt_12 = Point(Point(0, 0, 0))
xy_3 = XYPlane(Origin=Point(0, 0, 0))
pt_13 = Point(ceiling)
item_5 = ListItem(List=mid_ring_2, Index=number_slider_2, Wrap=True)
item_6 = ListItem(List=mid_ring_2, Index=number_slider_3, Wrap=True)
item_7 = ListItem(List=mid_ring_2, Index=0, Wrap=True)
colour_2 = ColourPicker(PickedColour=RGB(142, 153, 173))
ln_5 = Line(StartPoint=movetoplane_5.Geometry, EndPoint=end.End)
move = Move(Geometry=movetoplane_7.Geometry, Motion=ln_5)  # -> Geometry, Transform
origin = Point(Point(0, 0, 0))
ln_6 = Line(StartPoint=movetoplane_4.Geometry, EndPoint=origin)
item_8 = ListItem(List=solver.O, Index=0, Wrap=True)
item_9 = ListItem(List=cps.ClosestPoint, Index=0, Wrap=True)
item_10 = ListItem(List=cps.ClosestPoint, Index=Slider(1, range=0..1), Wrap=True)
pl_3pt_2 = Plane3Pt(PointA=item_7, PointB=item_6, PointC=item_5)
len_2 = Length(Curve=ln_6)
movetoplane_8 = MoveToPlane(Geometry=pt_13, Plane=xy_3, Above=True, Below=True)  # -> Geometry, Transform
number_slider_10 = Slider(1.5, range=0..10)
ln_7 = Line(StartPoint=pt_12, EndPoint=movetoplane_8.Geometry)
movetoplane_9 = MoveToPlane(Geometry=origin, Plane=base_plane, Above=True, Below=True)  # -> Geometry, Transform
ln_8 = Line(StartPoint=flatten(item_9), EndPoint=stake_points.Geometry)
ln_9 = Line(StartPoint=flatten(item_10), EndPoint=stake_points.Geometry)
end_2 = EndPoints(Curve=[ln_8, ln_9])  # -> Start, End
ln_10 = Line(StartPoint=movetoplane.Geometry, EndPoint=end_2.End)
move_2 = Move(Geometry=movetoplane_3.Geometry, Motion=ln_10)  # -> Geometry, Transform
line = LineSDL(Start=end_2.End, Direction=Vector(0, 0, 1), Length=Slider(11.5, range=0..20))
move_3 = Move(Geometry=move_2.Geometry, Motion=line)  # -> Geometry, Transform
pipe_4 = Pipe(Curve=[ln_8, ln_9], Radius=Slider(1.65, range=0..10), Caps=Slider(1, range=0..1))
mesh = Mesh(item_8)
preview_2 = CustomPreview(Geometry=pipe_4, Material=colour_2)
dist = Distance(PointA=stake_points.Geometry, PointB=movetoplane_9.Geometry)
mid_plane = Plane(pl_3pt_2)
line_2 = LineSDL(Start=end.End, Direction=Vector(0, 0, 1), Length=Slider(6.8, range=0..20))
move_4 = Move(Geometry=move.Geometry, Motion=line_2)  # -> Geometry, Transform
xy_4 = XYPlane(Origin=Point(0, 0, 0))
hypotenuse = Length(Curve=ln_8)
subtraction_2 = Subtraction(A=dist, B=hypotenuse)
line_3 = LineSDL(Start=pt_12, Direction=ln_7, Length=Slider(277, range=0..400))
item_11 = ListItem(List=subtraction_2, Index=0, Wrap=True)
colour_3 = ColourPicker(PickedColour=RGB(125, 125, 125))
preview_3 = CustomPreview(Geometry=move_3.Geometry, Material=colour_3)
pdecon_4 = Deconstruct(Point=ceiling)  # -> XComponent, YComponent, ZComponent
item_12 = ListItem(List=dist, Index=0, Wrap=True)
divide = DivideCurve(Curve=[ln_8, ln_9], Count=Slider(18, range=0..50), Kinks=False)  # -> flatten(Points), Tangents, Parameters
end_3 = EndPoints(Curve=line_3)  # -> Start, End
angsplitmsh = AngleSplitMesh(Mesh=mesh, Angle=0, Opposite=False)  # -> Split, R
cir = Circle(Plane=xy_4, Radius=len_2)
movetoplane_10 = MoveToPlane(Geometry=xy_4, Plane=base_plane, Above=True, Below=True)  # -> Geometry, Transform
item_13 = ListItem(List=hypotenuse, Index=0, Wrap=True)
cir_2 = Circle(Plane=xy_4, Radius=dist)
pt_14 = Point(base_points_2)
colour_4 = ColourPicker(PickedColour=RGB(106, 139, 156))
preview_4 = CustomPreview(Geometry=move_4.Geometry, Material=colour_3)
series = Series(Start=Slider(0, range=0..100), Step=1, Count=Slider(18, range=0..100))
sort_3 = SortList(Keys=pdecon_4.XComponent, ValuesA=ceiling)  # -> Keys, ValuesA
adjacent = Subtraction(A=item_12, B=len_2)
division = Division(A=adjacent, B=item_13)
theta = ArcCosine(Value=division)
tan = Tangent(Value=theta)
area = Area(Geometry=angsplitmsh.Split)  # -> Area, Centroid
movetoplane_11 = MoveToPlane(Geometry=end_3.End, Plane=base_plane, Above=True, Below=True)  # -> Geometry, Transform
pdecon_5 = Deconstruct(Point=movetoplane_11.Geometry)  # -> XComponent, YComponent, ZComponent
sort_4 = SortList(Keys=pdecon_5.XComponent, ValuesA=movetoplane_11.Geometry)  # -> Keys, ValuesA
movetoplane_12 = MoveToPlane(Geometry=cir_2, Plane=base_plane, Above=True, Below=True)  # -> Geometry, Transform
pline = PolyLine(Vertices=divide.Points, Closed=False)
movetoplane_13 = MoveToPlane(Geometry=cir, Plane=base_plane, Above=True, Below=True)  # -> Geometry, Transform
height = Multiplication(A=tan, B=item_12)
item_14 = ListItem(List=movetoplane_12.Geometry, Index=0, Wrap=True)
item_15 = ListItem(List=movetoplane_13.Geometry, Index=0, Wrap=True)
item_16 = ListItem(List=area.Area, Index=Slider(1, range=0..1), Wrap=True)
item_17 = ListItem(List=area.Area, Index=0, Wrap=True)
item_18 = ListItem(List=area.Area, Index=Slider(17, range=0..100), Wrap=True)
explode_2 = Explode(Curve=pline, Recursive=True)  # -> Segments, Vertices
colour_5 = ColourPicker(PickedColour=RGB(26, 51, 64))
item_19 = ListItem(List=pt_14, Index=[Slider(2, range=0..10), Slider(0, range=0..100)], Wrap=True)
ln_11 = Line(StartPoint=sort_3.ValuesA, EndPoint=sort_4.ValuesA)
end_4 = EndPoints(Curve=ln_11)  # -> Start, End
ln_12 = Line(StartPoint=movetoplane_2.Geometry, EndPoint=end_4.End)
move_5 = Move(Geometry=movetoplane_6.Geometry, Motion=ln_12)  # -> Geometry, Transform
line_4 = LineSDL(Start=end_4.End, Direction=Vector(0, 0, 1), Length=Slider(6.8, range=0..20))
move_6 = Move(Geometry=move_5.Geometry, Motion=line_4)  # -> Geometry, Transform
preview_5 = CustomPreview(Geometry=move_6.Geometry, Material=colour_3)
toggle = BooleanToggle(False)
length_line_2 = LengthLine(Line=explode_2.Segments, Strength=Slider(1000, range=0..1000))
colour_6 = ColourPicker(PickedColour=RGB(69, 73, 76))
divide_2 = DivideCurve(Curve=item_14, Count=Slider(8, range=0..10), Kinks=False)  # -> Points, Tangents, Parameters
Y = UnitY(Factor=item_19)
cone = Cone(Base=movetoplane_10.Geometry, Radius=item_12, Length=height)  # -> Cone, Tip
divide_3 = DivideCurve(Curve=item_15, Count=Slider(8, range=0..10), Kinks=False)  # -> Points, Tangents, Parameters
item_20 = ListItem(List=pt_14, Index=[Slider(1, range=0..1), Slider(7, range=0..10)], Wrap=True)
X = UnitX(Factor=item_20)
item_21 = ListItem(List=pt_14, Index=[Slider(3, range=0..10), Slider(5, range=0..10)], Wrap=True)
X_2 = UnitX(Factor=item_21)
neg_3 = Negative(Value=X_2)
number_slider_11 = Slider(100, range=0..100)
item_22 = ListItem(List=pt_14, Index=[Slider(6, range=0..10), Slider(4, range=0..10)], Wrap=True)
Y_2 = UnitY(Factor=item_22)
neg_4 = Negative(Value=Y_2)
number_slider_12 = Slider(5, range=0..5)
equalst = EqualityWithinTolerance(FirstNumber=item_16, SecondNumber=area.Area, Tolerance=number_slider_12)  # -> Equality, Inequality
equalst_2 = EqualityWithinTolerance(FirstNumber=item_17, SecondNumber=area.Area, Tolerance=number_slider_12)  # -> Equality, Inequality
equalst_3 = EqualityWithinTolerance(FirstNumber=item_18, SecondNumber=area.Area, Tolerance=number_slider_12)  # -> Equality, Inequality
cull_2 = CullPattern(List=series, CullPattern=equalst.Equality)
cull_3 = CullPattern(List=series, CullPattern=equalst_2.Equality)
cull_4 = CullPattern(List=series, CullPattern=equalst_3.Equality)
number_slider_13 = Slider(9, range=0..13)
smaller_2 = SmallerThan(FirstNumber=cull_2, SecondNumber=number_slider_13)  # -> SmallerThan, OrEqualTo
number_slider_14 = Slider(1.79, range=0..5)
pt_15 = Point([stake_points.Geometry, mid_ring_2])
rad = Radians(Degrees=Slider(22.5, range=0..100))
item_23 = ListItem(List=angsplitmsh.Split, Index=cull_3, Wrap=True)
item_24 = ListItem(List=angsplitmsh.Split, Index=cull_4, Wrap=True)
larger = LargerThan(FirstNumber=cull_2, SecondNumber=number_slider_13)  # -> LargerThan, OrEqualTo
unit = UnitVector(Vector=X)
unit_2 = UnitVector(Vector=neg_3)
cull_i = CullIndex(List=cull_2, Indices=Slider(0, range=0..100), Wrap=True)
item_25 = ListItem(List=angsplitmsh.Split, Index=cull_i, Wrap=True)
number_slider_15 = Slider(86, range=0..200)
wbthicken = WeaverbirdsMeshThicken(MeshCurves=item_25, Distance=number_slider_10, OffsetType=0)
pt_16 = Point(Point(0, 0, 0))
unit_3 = UnitVector(Vector=Y)
wbthicken_2 = WeaverbirdsMeshThicken(MeshCurves=item_24, Distance=number_slider_10, OffsetType=0)
unit_4 = UnitVector(Vector=neg_4)
pt_17 = Point(Point(0, 0, 100))
item_26 = ListItem(List=angsplitmsh.Split, Index=Slider(1, range=0..1), Wrap=True)
wbthicken_3 = WeaverbirdsMeshThicken(MeshCurves=item_23, Distance=number_slider_10, OffsetType=0)
movetoplane_14 = MoveToPlane(Geometry=cir, Plane=mid_plane, Above=True, Below=True)  # -> Geometry, Transform
srfsplit = SurfaceSplit(Surface=cone.Cone, Curves=movetoplane_14.Geometry)
item_27 = ListItem(List=srfsplit, Index=Slider(1, range=0..1), Wrap=True)
mesh_2 = Mesh(item_27)
qrmesh = QuadRemesh(Geometry=mesh_2, Settings={aqc=True, as=50, dhe=True, gci=0, null=False, pme=2, sa=0, tqc=2000})
demesh_3 = DeconstructMesh(Mesh=qrmesh)  # -> Vertices, Faces, Colours, Normals
pdecon_6 = Deconstruct(Point=demesh_3.Vertices)  # -> XComponent, YComponent, ZComponent
smaller_3 = SmallerThan(FirstNumber=pdecon_6.ZComponent, SecondNumber=mid_ring_z_2)  # -> SmallerThan, OrEqualTo
cull_5 = CullPattern(List=cull_2, CullPattern=larger.LargerThan)
item_28 = ListItem(List=angsplitmsh.Split, Index=cull_5, Wrap=True)
wbthicken_4 = WeaverbirdsMeshThicken(MeshCurves=item_28, Distance=number_slider_10, OffsetType=0)
ln_13 = Line(StartPoint=pt_16, EndPoint=pt_17)
rotax = RotateAxis(Geometry=divide_3.Points, Angle=rad, Axis=ln_13)  # -> Geometry, Transform
preview_6 = CustomPreview(Geometry=[wbthicken, item_26], Material=colour_4)
cull_6 = CullPattern(List=cull_2, CullPattern=smaller_2.OrEqualTo)
preview_7 = CustomPreview(Geometry=[wbthicken_4, wbthicken_2, wbthicken_3], Material=colour_5)
cull_7 = CullPattern(List=demesh_3.Vertices, CullPattern=smaller_3.OrEqualTo)
line_5 = LineSDL(Start=item_20, Direction=unit, Length=number_slider_15)
move_7 = Move(Geometry=item_20, Motion=line_5)  # -> Geometry, Transform
movetoplane_15 = MoveToPlane(Geometry=rotax.Geometry, Plane=mid_plane, Above=True, Below=True)  # -> Geometry, Transform
line_6 = LineSDL(Start=item_21, Direction=unit_2, Length=number_slider_15)
move_8 = Move(Geometry=item_21, Motion=line_6)  # -> Geometry, Transform
number_slider_16 = Slider(0.26, range=0..5)
cp = ClosestPoint(Point=[movetoplane_15.Geometry, divide_2.Points], Cloud=flatten(cull_7))  # -> ClosestPoint, CPIndex, Distance
colour_7 = ColourPicker(PickedColour=RGB(33, 36, 38))
line_7 = LineSDL(Start=item_22, Direction=unit_4, Length=number_slider_15)
move_9 = Move(Geometry=item_22, Motion=line_7)  # -> Geometry, Transform
pt_18 = Point(base_points)
item_29 = ListItem(List=pt_15, Index=0, Wrap=True)
item_30 = ListItem(List=pt_15, Index=Slider(1, range=0..1), Wrap=True)
item_31 = ListItem(List=pt_15, Index=Slider(2, range=0..10), Wrap=True)
item_32 = ListItem(List=pt_15, Index=Slider(3, range=0..10), Wrap=True)
line_8 = LineSDL(Start=item_19, Direction=unit_3, Length=number_slider_15)
move_10 = Move(Geometry=item_19, Motion=line_8)  # -> Geometry, Transform
cp_2 = ClosestPoint(Point=flatten([move_10.Geometry, move_7.Geometry, move_9.Geometry, move_8.Geometry]), Cloud=flatten(mid_ring_2))  # -> ClosestPoint, CPIndex, Distance
ln_14 = Line(StartPoint=[move_10.Geometry, move_7.Geometry, move_9.Geometry, move_8.Geometry], EndPoint=cp_2.ClosestPoint)
medges_3 = MeshEdges(Mesh=qrmesh)  # -> NakedEdges, InteriorEdges, NonManifoldEdges
show_2 = Show(G=qrmesh)
item_33 = ListItem(List=flatten(cull_7), Index=flatten(cp.CPIndex), Wrap=True)
number_slider_17 = Slider(0.81, range=0..5)
pipe_5 = Pipe(Curve=ln_11, Radius=number_slider_17, Caps=Slider(2, range=0..10))
preview_8 = CustomPreview(Geometry=pipe_5, Material=colour_6)
item_34 = ListItem(List=pt_18, Index=Slider(6, range=0..10), Wrap=True)
item_35 = ListItem(List=pt_18, Index=Slider(7, range=0..10), Wrap=True)
item_36 = ListItem(List=pt_18, Index=Slider(4, range=0..10), Wrap=True)
item_37 = ListItem(List=pt_18, Index=Slider(5, range=0..10), Wrap=True)
item_38 = ListItem(List=pt_18, Index=Slider(2, range=0..10), Wrap=True)
item_39 = ListItem(List=pt_18, Index=Slider(3, range=0..10), Wrap=True)
item_40 = ListItem(List=pt_15, Index=Slider(4, range=0..10), Wrap=True)
item_41 = ListItem(List=pt_18, Index=0, Wrap=True)
item_42 = ListItem(List=pt_18, Index=Slider(1, range=0..1), Wrap=True)
item_43 = ListItem(List=pt_15, Index=Slider(5, range=0..10), Wrap=True)
item_44 = ListItem(List=pt_15, Index=Slider(6, range=0..10), Wrap=True)
item_45 = ListItem(List=pt_15, Index=Slider(7, range=0..10), Wrap=True)
item_46 = ListItem(List=item_33, Index=Slider(1, range=0..1), Wrap=True)
item_47 = ListItem(List=item_33, Index=Slider(2, range=0..10), Wrap=True)
item_48 = ListItem(List=item_33, Index=Slider(3, range=0..10), Wrap=True)
flatten = FlattenTree(Tree=medges_3.InteriorEdges, Path="{0}")
item_49 = ListItem(List=item_33, Index=0, Wrap=True)
edgelengths_2 = EdgeLengths(Mesh=qrmesh, LengthFactor=Slider(0.32, range=0..1), Strength=number_slider_16)
item_50 = ListItem(List=pt_15, Index=Slider(8, range=0..10), Wrap=True)
item_51 = ListItem(List=pt_15, Index=Slider(9, range=0..10), Wrap=True)
length_line_3 = LengthLine(Line=flatten, Length=Slider(0.15, range=0..1), Strength=number_slider_16)
item_52 = ListItem(List=pt_15, Index=Slider(10, range=0..10), Wrap=True)
item_53 = ListItem(List=item_33, Index=Slider(5, range=0..10), Wrap=True)
item_54 = ListItem(List=pt_15, Index=Slider(11, range=0..100), Wrap=True)
item_55 = ListItem(List=item_33, Index=Slider(4, range=0..10), Wrap=True)
item_56 = ListItem(List=item_33, Index=Slider(6, range=0..10), Wrap=True)
item_57 = ListItem(List=item_33, Index=Slider(7, range=0..10), Wrap=True)
line_9 = LineSDL(Start=[item_34, item_42], Direction=unit, Length=number_slider_15)
line_10 = LineSDL(Start=[item_38, item_37], Direction=unit_2, Length=number_slider_15)
length_line_4 = LengthLine(Line=medges_3.NakedEdges, Length=Slider(0.569, range=0..1), Strength=Slider(7, range=1..25))
item_58 = ListItem(List=pt_15, Index=Slider(12, range=0..100), Wrap=True)
item_59 = ListItem(List=pt_15, Index=Slider(13, range=0..100), Wrap=True)
item_60 = ListItem(List=pt_15, Index=Slider(14, range=0..100), Wrap=True)
item_61 = ListItem(List=pt_15, Index=Slider(15, range=0..100), Wrap=True)
line_11 = LineSDL(Start=[item_36, item_35], Direction=unit_4, Length=number_slider_15)
line_12 = LineSDL(Start=[item_41, item_39], Direction=unit_3, Length=number_slider_15)
item_62 = ListItem(List=item_33, Index=Slider(8, range=0..10), Wrap=True)
item_63 = ListItem(List=item_33, Index=Slider(9, range=0..10), Wrap=True)
item_64 = ListItem(List=item_33, Index=Slider(10, range=0..10), Wrap=True)
item_65 = ListItem(List=item_33, Index=Slider(11, range=0..100), Wrap=True)
item_66 = ListItem(List=item_33, Index=Slider(12, range=0..100), Wrap=True)
item_67 = ListItem(List=item_33, Index=Slider(13, range=0..100), Wrap=True)
item_68 = ListItem(List=item_33, Index=Slider(14, range=0..100), Wrap=True)
item_69 = ListItem(List=item_33, Index=Slider(15, range=0..100), Wrap=True)
end_5 = EndPoints(Curve=[line_10, line_11, line_12, line_9])  # -> Start, End
cp_3 = ClosestPoint(Point=flatten(end_5.End), Cloud=flatten(mid_ring))  # -> flatten(ClosestPoint), CPIndex, Distance
anchor_2 = Anchor(Point=item_46, Target=item_51, Strength=number_slider_11)
anchor_3 = Anchor(Point=item_47, Target=item_54, Strength=number_slider_11)
anchor_4 = Anchor(Point=item_48, Target=item_52, Strength=number_slider_11)
anchor_5 = Anchor(Point=item_49, Target=item_50, Strength=number_slider_11)
anchor_6 = Anchor(Point=item_55, Target=item_59, Strength=number_slider_11)
anchor_7 = Anchor(Point=item_57, Target=item_61, Strength=number_slider_11)
anchor_8 = Anchor(Point=item_56, Target=item_60, Strength=number_slider_11)
anchor_9 = Anchor(Point=item_62, Target=item_45, Strength=number_slider_11)
anchor_10 = Anchor(Point=item_53, Target=item_58, Strength=number_slider_11)
anchor_11 = Anchor(Point=item_63, Target=item_29, Strength=number_slider_11)
anchor_12 = Anchor(Point=item_64, Target=item_30, Strength=number_slider_11)
anchor_13 = Anchor(Point=item_65, Target=item_31, Strength=number_slider_11)
anchor_14 = Anchor(Point=item_66, Target=item_32, Strength=number_slider_11)
anchor_15 = Anchor(Point=item_67, Target=item_40, Strength=number_slider_11)
anchor_16 = Anchor(Point=item_68, Target=item_43, Strength=number_slider_11)
anchor_17 = Anchor(Point=item_69, Target=item_44, Strength=number_slider_11)
ln_15 = Line(StartPoint=cp_3.ClosestPoint, EndPoint=end_5.End)
pipe_6 = Pipe(Curve=[line_11, line_12, line_9, line_10, ln_15], Radius=number_slider_17, Caps=Slider(2, range=0..10))
preview_9 = CustomPreview(Geometry=pipe_6, Material=colour_7)
colour_8 = ColourPicker(PickedColour=RGB(80, 101, 120))
demesh_4 = DeconstructMesh(Mesh=qrmesh)  # -> flatten(Vertices), Faces, Colours, Normals
flatten_2 = FlattenTree(Tree=demesh_4.Vertices, Path="{0}")
cp_4 = ClosestPoint(Point=divide.Points, Cloud=flatten_2)  # -> ClosestPoint, CPIndex, Distance
item_70 = ListItem(List=flatten(flatten_2), Index=flatten(cp_4.CPIndex), Wrap=True)  # -> flatten(Item)
ln_16 = Line(StartPoint=divide.Points, EndPoint=item_70)
length_line_5 = LengthLine(Line=ln_16, Length=Slider(0, range=0..100), Strength=Slider(7535, range=1..10000))
entwine_2 = Entwine(
    Branch00=show_2,
    Branch01=[anchor_5, anchor_2, anchor_3, anchor_4, anchor_6, anchor_10, anchor_8, anchor_7, anchor_9, anchor_11, anchor_12, anchor_13, anchor_14, anchor_15, anchor_16, anchor_17],
    Branch02=edgelengths_2,
    Branch03=length_line_2,
    Branch04=length_line_5,
    Branch05=length_line_3,
    Branch06=length_line_4,
    FlattenInputs=True)
bouncysolver = BouncySolver(GoalObjects=flatten(entwine_2), Reset=Button(), Threshold=1e-15, Tolerance=0.0001, Damping=0.99, Iterations=10, On=True)  # -> I, flatten(V), flatten(O)
item_71 = ListItem(List=bouncysolver.O, Index=Slider(0, range=0..100), Wrap=True)
mesh_3 = Mesh(item_71)
wbthicken_5 = WeaverbirdsMeshThicken(MeshCurves=mesh_3, Distance=number_slider_10, OffsetType=0)
material = CreateMaterial(Diffuse=colour_8, Specular=RGB(255, 254, 255), Emission=RGB(0, 0, 0), Transparency=Slider(0.22, range=0..1), Shine=0)
preview_10 = CustomPreview(Geometry=wbthicken_5, Material=material)
