# Grasshopper definition staircase.ghx (Grasshopper 1.0.8)
# plug-ins: Bifocals

degrees_of_staircase_how_many_rotations = Slider(1024.302, range=360..7200)
height_of_staircase = Slider(89.125, range=10..200)
number_of_points = Slider(272, range=20..400)
pi = Pi(Factor=1)
num = Number(180)
pi_180 = Division(A=pi, B=num)
thickness_of_central_pole_lower_thicker = Slider(5, range=4..10)
dom = ConstructDomain(DomainStart=0, DomainEnd=height_of_staircase)
dom_2 = ConstructDomain(DomainStart=0, DomainEnd=degrees_of_staircase_how_many_rotations)
radius_of_staircase = Slider(16.231, range=10..100)
multiplication = Multiplication(A=degrees_of_staircase_how_many_rotations, B=radius_of_staircase)
perimeter_of_staircase = Multiplication(A=multiplication, B=pi_180)
pt = Point(Point(0, 0, 0))
range = Range(Domain=dom, Steps=number_of_points)
range_2 = Range(Domain=dom_2, Steps=number_of_points)
height_per_degree = Division(A=height_of_staircase, B=degrees_of_staircase_how_many_rotations)
height_of_railing_range_2_5_to_3_5_gap = Slider(169, range=144..216)
division = Division(A=radius_of_staircase, B=thickness_of_central_pole_lower_thicker)
number_of_poles_in_railing = Slider(90, range=0..500)
division_2 = Division(A=perimeter_of_staircase, B=number_of_poles_in_railing)
multiplication_2 = Multiplication(A=height_per_degree, B=height_of_railing_range_2_5_to_3_5_gap)
line = LineSDL(Start=pt, Direction=Vector(0, 0, 1), Length=height_of_staircase)
pt_2 = PointCylindrical(BasePlane=pt, Angle=degrees(range_2), Radius=radius_of_staircase, Elevation=range)
center_pole = Cylinder(Base=pt, Radius=division, Length=height_of_staircase)
num_2 = Number(0.0025)
cap = CapHoles(Brep=center_pole)
_0_to_100_of_permitted_pole_thickness = Slider(59, range=0..100)
multiplication_3 = Multiplication(A=division_2, B=num_2)
intcrv = Interpolate(Vertices=pt_2, Degree=3, Periodic=False, KnotStyle=1)  # -> Curve, Length, Domain
num_3 = Number(1)
number_of_steps = Slider(65, range=12..240)
divide = DivideCurve(Curve=line, Count=number_of_steps, Kinks=False)  # -> Points, Tangents, Parameters
loft = Loft(
    Curves=flatten([line, intcrv.Curve]),
    Options={Adjust=False, Closed=False, LoftEnds=0, LoftSimp=0, LoftType=0, Rebuild=10, Refit=0.01})
num_4 = Number(0.2)
divide_2 = DivideDomain²(Domain=loft, UCount=num_3, VCount=number_of_steps)
Z = UnitZ(Factor=1)
xy = XYPlane(Origin=divide.Points)
multiplication_4 = Multiplication(A=_0_to_100_of_permitted_pole_thickness, B=multiplication_3)
radius_of_helix_radius_of_poles = Subtraction(A=radius_of_staircase, B=multiplication_4)
subtraction = Subtraction(A=radius_of_helix_radius_of_poles, B=num_4)
pt_3 = PointCylindrical(BasePlane=pt, Angle=degrees(range_2), Radius=subtraction, Elevation=range)
subsrf = Isotrim(Surface=loft, Domain=divide_2)
intcrv_2 = Interpolate(Vertices=pt_3, Degree=3, Periodic=False, KnotStyle=1)  # -> Curve, Length, Domain
divide_3 = DivideCurve(Curve=intcrv_2.Curve, Count=number_of_poles_in_railing, Kinks=False)  # -> Points, Tangents, Parameters
amp = Amplitude(Vector=Z, Amplitude=multiplication_2)
poles_cut_into_steps_slightly = Slider(-0.01, range=-0.5..-0.01)
project = Project(Geometry=subsrf, Plane=xy)  # -> Geometry, Transform
num_5 = Number(0.5)
subtraction_2 = Subtraction(A=multiplication_2, B=poles_cut_into_steps_slightly)
item = ListItem(List=divide.Points, Index=0, Wrap=True)  # -> Item, Item1
num_6 = Number(2)
Z_2 = UnitZ(Factor=1)
thickness_of_handrail = Slider(0.8, range=0.1..5)
extend_ends_of_railings = ExtendCurve(Curve=intcrv.Curve, Type=num_6, Start=num_5, End=num_5)
dist = Distance(PointA=item.Item, PointB=item.Item1)
cull_i = CullIndex(List=project.Geometry, Indices=number_of_steps, Wrap=True)
amp_2 = Amplitude(Vector=Z_2, Amplitude=poles_cut_into_steps_slightly)
move = Move(Geometry=divide_3.Points, Motion=amp_2)  # -> Geometry, Transform
railing_poles = Cylinder(Base=move.Geometry, Radius=multiplication_4, Length=subtraction_2)
move_2 = Move(Geometry=extend_ends_of_railings, Motion=amp)  # -> Geometry, Transform
num_7 = Number(2)
srf = Surface(cull_i)
pipe = Pipe(Curve=move_2.Geometry, Radius=thickness_of_handrail, Caps=num_7)
multiplication_5 = Multiplication(A=Slider(1.3, range=1..1.5), B=dist)
Z_3 = UnitZ(Factor=multiplication_5)
cap_2 = CapHoles(Brep=railing_poles)
cap_3 = CapHoles(Brep=pipe)
extr = Extrude(Base=srf, Direction=Z_3)
sunion = SolidUnion(Breps=[cap, extr])
sunion_2 = SolidUnion(Breps=[cap_3, cap_2])
col = Colour(RGB(56, 54, 66))
preview = CustomPreview(Geometry=sunion, Material=simplify(flatten(col)))
col_2 = Colour(RGB(56, 54, 66))
preview_2 = CustomPreview(Geometry=sunion_2, Material=simplify(graft(col_2)))
